# Dynamo graph Quadrillage_input_list.dyn (Dynamo 3.7.0.11777)

code_block = CodeBlock { distList = [4, 5, 5, 4]; }
python_script = Python(IN[0]=code_block)  # CPython3
# ---------- python_script.python (6 lines) ----------
d = IN[0]
OUT = [0]
s = 0
for v in d:
    s += v
    OUT.append(s)
# ----------------------------------------
byCoordinates = Point.ByCoordinates(y=python_script)
code_block_2 = CodeBlock { distList = [3, 5, 4, 4]; }
python_script_2 = Python(IN[0]=code_block_2)  # CPython3; same code as python_script
maximumItem = List.MaximumItem(list=python_script_2)
translate = Geometry.Translate(geometry=byCoordinates, xTranslation=maximumItem)
byStartPointEndPoint = Grid.ByStartPointEndPoint(start=translate, end=byCoordinates)
byCoordinates_2 = Point.ByCoordinates(x=python_script_2)
maximumItem_2 = List.MaximumItem(list=python_script)
translate_2 = Geometry.Translate(geometry=byCoordinates_2, yTranslation=maximumItem_2)
byStartPointEndPoint_2 = Grid.ByStartPointEndPoint(start=translate_2, end=byCoordinates_2)
